# Grasshopper definition UFv1.gh (Grasshopper 1.0.8)

uf_run = BooleanToggle(False)
uf_srf = Brep(<brep referenced from the Rhino model>)
uf_edge = Slider(60, range=10..200)
uf_allow = Slider(15, range=0..100)
uf_iters = Slider(30, range=5..300)
uf_maxverts = Slider(5000, range=500..40000)
uf_path = Panel("C:\Users\leeja\Documents\dev\26_AdaptiveMold_development")
ufv1_material = Python3Script(platform_path=uf_path)  # -> out, props, info; inputs platform_path: String, name: String, thickness: Double, elong_max: Double, wrinkle_penalty: Double, source: String
#   port platform_path: 저장소 루트의 절대경로. 이 아래 unfold/src 를 sys.path 에 넣어 계산 모듈을 불러온다. 예: C:\Users\leeja\Documents\dev\26_AdaptiveMold_development 필수 — 비어 있으면 props 가 나오지 않는다.
#   port name: 재료 이름. 예: AL-5052, STS304 [기록] 계산에 쓰이지 않는다. 결과를 나중에 알아보기 위한 것이다.
#   port thickness: 판재 두께 (mm). [기록] 형상에는 영향이 없다 — v1 은 막(membrane) 모델이라 두께가 평탄화 결과를 바꾸지 않는다. 그래도 받아 두는 이유는 결과에 어떤 판재를 전제했는지 남기기 위해서다. 0 이하면 물성 전체가 거부된다.
#   port elong_max: 균일연신률. **비율**이다 — 12% 는 12 가 아니라 0.12. [판정] 찢어짐 판정의 한계값. 최대 성형 변형률이 이 값을 넘는 요소를 경고한다. 비워 두면 찢어짐은 '통과'가 아니라 '미판정'으로 남는다. 0 이하거나 1 을 넘으면 거부된다(퍼센트를 그대로 넣은 실수).
#   port wrinkle_penalty: σ>1 (성형에서 압축되는) 요소에 주는 벌점. 기본 1.0. [형상] 이 컴포넌트에서 결과 형상을 바꾸는 유일한 값이다. 1.0 은 순수 ARAP — 에너지가 단조 감소한다는 것이 보장된 경로다. 1 보다 크게 하면 주름을 줄이는 쪽으로 당기지만 **수렴성이 증명되지 않았다.** 결과가 요동치면 1.0 으로 되돌릴 것. 1 미만은 부호가 뒤집혀 주름을 키우므로 거부된다.
#   port source: 이 숫자들이 어디서 왔는가. 예: 사내 시험성적서 2026-03 [기록] 비어 있어도 계산은 되지만 info 에 '출처 미기재'가 남는다. 출처 없는 연신률은 나중에 검증할 수가 없다.
#   port out: 표준출력(print). 정상 동작에서는 비어 있다.
#   port props: 물성 객체. UFv1 Flatten 의 props 에 물린다. 검증에 걸리면 None 이 나온다 — 잘못된 물성을 하류로 흘려보내지 않기 위해서다. 그때 info 의 [경고] 줄을 읽을 것.
#   port info: 무엇이 형상을 바꿨고 무엇이 기록일 뿐인지. [형상] / [판정] / [기록] 세 등급으로 적힌다. ARAP 에너지에는 탄성계수도 푸아송비도 들어가지 않으므로, 돌려도 아무 일이 안 일어나는 '가짜 손잡이'를 만들지 않으려고 등급을 명시한다.
# ---------- ufv1_material: Python ----------
# -*- coding: utf-8 -*-
# UFv1 Material — 물성을 한 덩어리로 묶어 내보낸다
#
# Flatten 의 입력을 물성 수만큼 늘리는 대신 객체 하나를 물린다.
# AMv1 을 Base/Check/Play 로 쪼갠 것과 같은 이유다.
#
# **프리셋은 없다.** 알루미늄 균일연신률을 출처와 함께 댈 수 없기 때문이다.
# 근거 없는 기본값을 넣으면 아무도 안 고치고 그대로 쓴다.
#
# ── 입력 (Rhino 8 스크립트 에디터에서 이 순서대로 만든다) ──────────────
#   platform_path    str    repo root (필수)
#   name             str    재료 이름
#   thickness        float  두께 mm — **형상에는 영향 없음** (막 모델)
#   elong_max        float  균일연신률 **비율**. 12% 는 0.12
#   wrinkle_penalty  float  σ>1 쪽 벌점. 1.0 이 순수 ARAP(증명된 경로)
#   source           str    이 숫자들이 어디서 왔는가
#
# ── 출력 ────────────────────────────────────────────────────────────
#   props   object  UFv1 Flatten 에 물린다
#   info    str     무엇이 형상을 바꿨고 무엇이 기록인지

import os
import sys

props = None
info = ""

root = str(platform_path or "").strip().strip('"').strip("'")
if not root or not os.path.isdir(root):
    info = "platform_path 가 필요하다 (repo root 폴더)"
else:
    src = os.path.join(root, "unfold", "src")
    if src not in sys.path:
        sys.path.insert(0, src)
    # Rhino 는 프로세스가 사는 동안 모듈을 캐시한다. 저장소 코드를 고친 뒤
    # 다시 계산해도 옛 모듈이 그대로 돌아 **고친 적 없는 결과**가 나온다.
    _norm = os.path.normcase(os.path.normpath(src))
    for _n in [n for n in list(sys.modules)
               if getattr(sys.modules.get(n), "__file__", None)
               and os.path.normcase(
                   os.path.normpath(sys.modules[n].__file__)).startswith(_norm)]:
        del sys.modules[_n]

    import material as mt

    props = mt.MaterialProps(
        name=str(name or ""),
        thickness=float(thickness) if thickness is not None else None,
        elong_max=float(elong_max) if elong_max is not None else None,
        wrinkle_penalty=float(wrinkle_penalty) if wrinkle_penalty is not None else 1.0,
        source=str(source or ""))

    parts = [props.describe()]
    for p in props.problems:
        parts.append("[경고] " + p)
    for n in props.notes:
        parts.append("[참고] " + n)
    info = "\n".join(parts)

    if not props.ok:
        # 잘못된 물성을 하류로 흘려보내지 않는다. Flatten 이 props 없음으로
        # 보고 기본 물성으로 도는 편이, 틀린 값으로 도는 것보다 낫다.
        props = None
# ---------- end ufv1_material ----------
ufv1_flatten = Python3Script(
    platform_path=uf_path,
    srf=uf_srf,
    props=ufv1_material.props,
    edge_mm=uf_edge,
    allow_mm=uf_allow,
    iters=uf_iters,
    run=uf_run)  # -> out, flat, blank, strain, warn, info; inputs platform_path: String, srf: Brep, edge_mm: Double, allow_mm: Double, iters: Int32, max_verts: Int32, run: Boolean
#   port platform_path: 저장소 루트의 절대경로. 이 아래 unfold/src 를 sys.path 에 넣어 계산 모듈을 불러온다. 예: C:\Users\leeja\Documents\dev\26_AdaptiveMold_development 필수 — 비어 있으면 아무것도 계산되지 않는다.
#   port srf: 전개할 곡면 한 장 (Surface 또는 Brep). 필수. 조건이 좁다 — 구멍 없는 원판 한 장만 편다. 구멍이 있거나(경계 루프 2개 이상), 닫혀 있거나, 조각이 여럿이면 계산하지 않고 위상 경고를 낸다. 한 장씩 넣을 것.
#   port props: UFv1 Material 의 props 출력. 선택 — 안 물리면 기본 물성으로 돌고, 찢어짐은 미판정으로 남는다(경고에 그렇게 적힌다).
#   port edge_mm: 메쉬 목표 변 길이 (mm). 기본 40. 작을수록 결과가 정밀해지지만 정점이 제곱으로 늘고 시간도 그만큼 든다 — 절반으로 줄이면 대략 4배다. 먼저 60~80 으로 형상과 판정을 보고, 말이 되면 30~40 으로 다시 돌리는 순서를 권한다.
#   port allow_mm: 재단 여유 (mm). 기본 15. 재단선은 평탄화 경계보다 항상 이 값 이상 바깥에 놓인다. 경계 단순화가 안쪽으로 파고들 수 있어 그만큼(1mm)을 더해 오프셋하므로, 실측 여유는 요구치보다 조금 크다. 예외: 내각 23.1도 미만의 뾰족한 꼭짓점에서는 보증이 깨진다. 그때는 info 에 실측 여유가 굵게 적힌다.
#   port iters: ARAP local-global 최대 반복. 기본 30. 에너지 상대변화가 1e-6 아래로 떨어지면 그 전에 멈춘다. '미수렴' 경고가 뜨면 여기를 올린다. 다만 에너지가 이미 바닥이면(원통에서 3.4e-05) 결과는 그대로 쓸 만하다.
#   port max_verts: 정점 상한. **비워 두면 이 환경의 속도로 자동 계산한다.** 이 컴포넌트는 Rhino UI 스레드에서 돌기 때문에 계산 시간이 곧 화면이 멈춰 있는 시간이다. 그래서 상한을 개수가 아니라 시간 예산(3초)에서 거꾸로 잡는다 — numpy 가 붙으면 약 8100개, 순수 파이썬이면 약 600개. 넘으면 계산하지 않고 '약 몇 초 걸린다'를 경고에 적는다. 오래 걸려도 좋으면 여기에 직접 큰 값을 넣으면 그 값이 이긴다.
#   port run: 계산 스위치. 켜야 돈다. 이 컴포넌트는 Rhino UI 스레드에서 도므로, 슬라이더를 만질 때마다 다시 계산하면 그때마다 Rhino 가 멈춘다. 꺼져 있을 때의 빈 결과는 '통과'가 아니라 '미판정'이다 — warn 에 그렇게 적힌다.
#   port out: 표준출력(print). 정상 동작에서는 비어 있다.
#   port flat: 평탄화된 평면 메쉬 (z=0). 결과는 무게중심이 원점에, 주축이 +X 가 되도록 정렬된다. 정사각형처럼 주축이 없는 형상은 방향이 자유롭다 — 1200x1200 패널이 45도 돌아 나오는 것은 그 때문이고, 계산은 맞다.
#   port blank: 재단 외곽선. 닫힌 폴리라인. 평탄화 경계에서 allow_mm 이상 바깥으로 떨어져 있다. 오목 모서리에서 자기교차할 수 있는데, v1 은 고치지 않고 검출해서 info 에 알린다 — 그 경우 손으로 확인할 것.
#   port strain: σ 색칠 메쉬. flat 과 같은 자리에 겹치므로 색을 보려면 flat 쪽 프리뷰를 끈다. 파랑 = σ<1 (성형에서 늘어남), 흰색 = σ=1 (변형 없음), 빨강 = σ>1 (성형에서 압축 = 주름 위험). σ 가 1 에서 0.20 벗어나면 만색이 된다.
#   port warn: 판정 목록. 한 줄에 하나씩 (\n 으로 이어져 있다). 주름 / 찢어짐 / 뒤집힘 / 수렴 네 가지를 통과·경고·미판정으로 적는다. **통과한 것도 적는다** — 빈 목록이 '검사했고 괜찮다' 인지 '검사를 안 했다'인지 구별되지 않으면 판정이 쓸모없다. 주름 경고는 개수가 아니라 '최대 압축 %' 로 읽을 것. 가전개면인 원통에서도 수치 잔차로 요소 절반이 걸리는데 실제 압축은 0.001% 다.
#   port info: 요약. 메쉬 크기 / 계산에 걸린 시간과 엔진 / 반복과 수렴 / 초기 배치 방법 / σ 범위 / 최대 성형 변형률 / 3D 대비 평면 면적비 / 재단선 점 수와 실측 여유 / 물성 등급. '계산 N초' 는 그동안 Rhino 가 멈춰 있던 시간이다. 'numpy 없음' 이 보이면 스크립트 첫 줄의 '# r: numpy' 가 빠진 것이다 — 같은 메쉬가 20배 느려진다.
# ---------- ufv1_flatten: Python ----------
# r: numpy
# -*- coding: utf-8 -*-
# UFv1 Flatten — 복곡면 한 장을 성형 전 블랭크로 편다
#
# **첫 줄의 `# r: numpy` 가 이 컴포넌트에서 가장 값이 큰 한 줄이다.**
# 이게 없으면 Rhino 8 의 py39 는 numpy 를 못 보고 solver 가 순수 파이썬으로
# 돈다 — 실측 2026-08-14, 돔 2049정점: 10.28 s → 0.50 s (20.6배). GH 스크립트
# 컴포넌트는 Rhino UI 스레드에서 돌기 때문에 그 시간이 그대로 **화면이 얼어붙는
# 시간**이다. numpy 를 못 끌어오는 환경에서도 solver 는 순수 경로로 계산은 하고,
# 그때는 info 에 "numpy 없음"이 찍힌다 — 느린 이유가 화면에 남아야 한다.
#
# **판단은 여기서 하지 않는다.** pipeline.run() 이 끝낸 결과를 화면에 옮기기만
# 한다. 어댑터가 판단을 시작하면 같은 판단이 두 곳에 생기고, 둘이 어긋나는 날
# 화면과 숫자가 다른 말을 하게 된다.
#
# **run 토글이 있는 이유**: GH 스크립트 컴포넌트는 Rhino UI 스레드에서 돈다.
# 5초 걸리는 계산은 5초 동안 Rhino 를 얼린다. 슬라이더를 만질 때마다 도는 것을
# 막아야 한다.
#
# ── 입력 (Rhino 8 스크립트 에디터에서 이 순서대로 만든다) ──────────────
#   platform_path  str     repo root (필수)
#   srf            Brep    전개할 곡면 한 장
#   props          object  UFv1 Material 출력. 없으면 기본 물성 + 경고
#   edge_mm        float   목표 요소 크기 (기본 40)
#   allow_mm       float   트림 여유 (기본 15)
#   iters          int     최대 반복 (기본 30)
#   max_verts      int     정점 상한. 비워 두면 이 환경 속도로 자동 계산한다
#                          (numpy 있으면 ≈8000, 없으면 ≈600). 넘으면 계산하지 않는다
#   run            bool    계산 스위치
#
# ── 출력 ────────────────────────────────────────────────────────────
#   flat    Mesh    평면 메쉬
#   blank   Curve   재단 외곽 (여유 포함)
#   strain  Mesh    σ 색칠 — 파랑 σ<1(성형에서 인장), 빨강 σ>1(주름 위험)
#   warn    str     경고·판정 한 줄씩 (\n 으로 이은 문자열). **통과한 것도 적는다**
#   info    str     요약
#
# **warn 이 목록이 아니라 문자열인 이유** (실측 2026-08-14): Rhino 8 의 새
# Script 컴포넌트는 파이썬 리스트를 GH 항목으로 갈라주지 않는다. 출력
# 파라미터를 list 접근으로 만들어도 `GH_ObjectWrapper(PyObject)` 하나로 나오고,
# string 힌트를 걸면 리스트를 통째로 `['...', '...']` 로 문자열화한다. 그대로 두면
# 패널에 대괄호와 따옴표가 찍혀 판정을 읽을 수가 없다. 그래서 여기서 잇는다.

import os
import sys
import time

flat = None
blank = None
strain = None
warn = []
info = ""

root = str(platform_path or "").strip().strip('"').strip("'")

if not root or not os.path.isdir(root):
    warn = ["platform_path 가 필요하다 (repo root 폴더)"]
elif not run:
    # **미판정이지 통과가 아니다.** 빈 결과를 통과로 읽으면 안 된다.
    warn = ["run 이 꺼져 있다 — 계산하지 않았다. 미판정이지 통과가 아니다"]
elif srf is None:
    warn = ["srf 가 비어 있다"]
else:
    src = os.path.join(root, "unfold", "src")
    if src not in sys.path:
        sys.path.insert(0, src)
    # Rhino 모듈 캐시를 지운다 — 안 지우면 저장소 코드를 고쳐도 옛 모듈이 돈다.
    _norm = os.path.normcase(os.path.normpath(src))
    for _n in [n for n in list(sys.modules)
               if getattr(sys.modules.get(n), "__file__", None)
               and os.path.normcase(
                   os.path.normpath(sys.modules[n].__file__)).startswith(_norm)]:
        del sys.modules[_n]

    import material as mt
    import pipeline as pl
    import rhino_io as rio
    import solver as sv

    use = props if props is not None else mt.DEFAULT
    if props is None:
        warn.append("[참고] props 가 없어 기본 물성으로 돌았다 — "
                    "찢어짐 판정은 미판정이다")

    verts, faces, notes = rio.mesh_from_brep(srf, float(edge_mm or 40.0))
    if not faces:
        warn.extend("[경고] " + n for n in notes)
        info = "\n".join(notes)
    else:
        # **걸린 시간을 적는다.** 이 컴포넌트는 UI 스레드에서 도니까 이 숫자가
        # 곧 Rhino 가 멈춰 있던 시간이다. 화면에 안 적으면 "느리다"가 느낌으로만
        # 남아 정점 수·요소 크기 중 무엇을 줄여야 하는지 판단할 수가 없다.
        _t0 = time.time()
        # max_verts 를 안 주면 pipeline 이 **이 환경의 속도로부터** 상한을
        # 계산한다. 여기서 숫자를 박으면 numpy 유무를 모르는 채로 정하게 된다.
        out = pl.run(verts, faces, use,
                     allow_mm=float(allow_mm if allow_mm is not None else 15.0),
                     iters=int(iters or 30),
                     max_verts=int(max_verts) if max_verts else None)
        _dt = time.time() - _t0
        _engine = "numpy %s" % (sv.numpy.__version__ if sv.HAS_NUMPY
                                else "없음 — 순수 파이썬 (수십 배 느리다)")
        warn.extend(out.warn)
        # 거부된 경우(정점 상한 등)에는 시간을 적지 않는다 — "계산 0.00 s" 는
        # 빨랐다는 뜻이 아니라 계산을 안 했다는 뜻인데, 그렇게 읽히지 않는다.
        took = ("계산 %.2f s — 그동안 Rhino 는 멈춰 있다 (%s)\n" % (_dt, _engine)
                if out.ok else "")
        info = "\n".join(notes) + "\n" + took + out.info
        if out.ok:
            flat = rio.to_mesh(out.uv, out.faces)
            strain = rio.to_strain_mesh(out.uv, out.faces, out.sigmas)
            blank = rio.to_curve(out.curve)

# 판정을 한 줄씩 잇는다 (위 머리말 참고). 목록으로 두면 패널이 못 읽는다.
warn = "\n".join(warn)
# ---------- end ufv1_flatten ----------
uf_matname = Panel("AL-5052")
uf_source = Panel("사내 시험성적서 2026-03")
uf_thick = Slider(3, range=0.5..10)
uf_elong = Slider(0.12, range=0..0.5)
uf_penalty = Slider(1, range=1..10)
